# Grasshopper definition 03_10_2026_Evaporative Cooling tower.gh (Grasshopper 1.0.7)
# plug-ins: LadybugGrasshopper, Bifocals, Human

searchconstrset = HBSearchConstructionSets()  # -> constr_sets; plug-in component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
item_selector = ItemSelector(
    searchconstrset,
    {"1980_2004::ClimateZone1::Mass", "1980_2004::ClimateZone1::Metal Building", "1980_2004::ClimateZone1::SteelFramed", "1980_2004::ClimateZone1::WoodFramed", "1980_2004::ClimateZone2::Mass", "1980_2004::ClimateZone2::Metal Building"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}, selected="2004::ClimateZone3::Mass")

cooling_downdraft_tower2 = Brep(<brep referenced from the Rhino model>)
cooling_downdraft_tower3 = Brep(<brep referenced from the Rhino model>)
# Extracting parameters from the Parametric Tower
cooling_downdraft_tower1 = Brep(<brep referenced from the Rhino model>)

solid_union = SolidUnion(Breps=[cooling_downdraft_tower1, cooling_downdraft_tower2, cooling_downdraft_tower3])
area = Area(Geometry=cooling_downdraft_tower2)  # -> Area, Centroid
preview = CustomPreview(Geometry=cooling_downdraft_tower2, Shader=ColourSwatch(SwatchColor=RGB(65, 186, 180)))
preview_2 = CustomPreview(Geometry=[cooling_downdraft_tower1, cooling_downdraft_tower3], Shader=ColourSwatch(SwatchColor=RGB(25, 255, 224)))
bounding_box = BoundingBox(Content=solid_union, Plane=PlaneXY(0, 0, 0))  # -> Box, Box_2
deconstruct_box = DeconstructBox(Box=bounding_box.Box)  # -> Plane, X, Y, Z
multiplication = Multiplication(A=area.Area, B="0.25")
deconstruct_domain = DeconstructDomain(Domain=deconstruct_box.Z)  # -> Start, End
subtraction = Subtraction(A=deconstruct_domain.End, B=deconstruct_domain.Start)
tower_height = Panel(subtraction)

cool_zoneadiabatic = Brep([<brep referenced from the Rhino model> x2])
arches = Brep([<brep referenced from the Rhino model> x4])
brep = Brep(<brep referenced from the Rhino model>)

# ---- group: Shade
deep_arch_shading = Brep([<brep referenced from the Rhino model> x4])
courtyardshading = Brep([<brep referenced from the Rhino model> x2])

# ----
# Thermal Zone model
hb_building_programs = HBBuildingPrograms({"LargeOffice", "MediumOffice", "SmallOffice", "MidriseApartment", "HighriseApartment", "Retail", "StripMall", "PrimarySchool", "SecondarySchool", "SmallHotel", "LargeHotel", "Hospital", "Outpatient", "Laboratory", "Warehouse", "SuperMarket", "FullServiceRestaurant", "QuickServiceRestaurant", "Courthouse", "LargeDataCenterHighITE", "LargeDataCenterLowITE", "SmallDataCenterHighITE", "SmallDataCenterLowITE"}, selected="MidriseApartment")
searchprog = HBSearchPrograms(bldg_prog=hb_building_programs)  # -> room_prog; plug-in component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
aperture = HBAperture(geo=arches, operable=Toggle(True))  # -> out, apertures; plug-in component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

evaporation_area = Panel(multiplication)
panel = Panel("""ZoneCoolTower:Shower,
    MyCoolTower,             !- Name
    MyTowerSch,              !- Availability Schedule Name
    Zone_1,                  !- Zone Name
    ,                        !- Water Supply Storage Tank Name
    WindDrivenFlow,          !- Flow Control Type
    MyTowerSch,              !- Pump Flow Rate Schedule Name
    0.0005,                  !- Maximum Water Flow Rate {m3/s}""")

panel_2 = Panel("""    10,                      !- Maximum Air Flow Rate {m3/s}
    18,                      !- Minimum Indoor Temperature {C}
    0.05,                    !- Fraction of Water Loss
    0.05,                    !- Fraction of Flow Schedule
    250;                     !- Rated Power Consumption {W}""")
# Creating the Energy Plus object using custom tower input parameters
panel_3 = Panel(",                      !- Effective Tower Height {m}")
concatenate = Concatenate(FragmentA=tower_height, FragmentB=panel_3)
concatenate_2 = Concatenate(FragmentA=evaporation_area, FragmentB=",                       !- Airflow Outlet Area {m2}")
data = Data(flatten(concatenate))
data_2 = Data([panel, data, concatenate_2, panel_2])
panel_4 = Panel(data_2)

list_item = ListItem(List=searchprog, Index=0, Wrap=True)
roomsolid = HBRoomFromSolid(geo=flatten(brep), name="Zone_1", constr_set=item_selector, program=list_item, conditioned=Toggle(True))  # -> out, rooms; plug-in component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
guidesurface = HBPropertiesByGuideSurface(rooms=roomsolid.rooms, guide=cool_zoneadiabatic, bc="Adiabatic")  # -> rooms; plug-in component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

# ----
# Seasonal Scheduling for the Tower
gene_pool = GenePool(
    Decimals=0,
    Maximum=1,
    Minimum=0,
    Value=[0.5, 0.5, 0.5, 0.5, 0.5, 0.5, 0.5, 0, 0, 0, 0, 1, 1, 1, 1, 1, 1, 1, 0, 0.5, 0.5, 0.5, 0.5, 0.5])
number_slider = Slider(15, range=0..100)
analysisperiod = LBAnalysisPeriod(
    start_month=Slider(5, range=0..100),
    start_day=number_slider,
    start_hour=0,
    end_month=Slider(10, range=0..100),
    end_day=number_slider,
    timestep=Slider(1, range=0..1))  # -> period, hoys, dates; plug-in component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
constantschedule = HBConstantSchedule(values=gene_pool)  # -> out, schedule, idf_text; plug-in component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
constantschedule_2 = HBConstantSchedule(values=Slider(0, range=0..1))  # -> out, schedule, idf_text; plug-in component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
# KEY NOTES: The Tower schedule has to be given a unique Identifier name to be referred to the Evaporative cooling tower INPUT string.
seasonalschedule = HBSeasonalSchedule(
    base_schedule=constantschedule_2.schedule,
    season_scheds=constantschedule.schedule,
    analysis_periods=analysisperiod.period,
    name="MyTowerSch")  # -> out, schedule, idf_year, idf_week, idf_days; plug-in component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
schtodata = HBScheduleToData(schedule=seasonalschedule.schedule)  # -> data; plug-in component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
merge = Merge(Data1=seasonalschedule.idf_year, Data2=seasonalschedule.idf_week, Data3=seasonalschedule.idf_days)  # -> flatten(Result)
hourlyplot = LBHourlyPlot(data=schtodata)  # -> out, mesh, legend, borders, labels, title, vis_set; plug-in component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

# ----
# KEY NOTES: The Energy Zone has to be given a unique Identifier name to be referred to the Evaporative cooling tower INPUT string.
id = HBSetIdentifier(hb_obj=guidesurface, id="Zone_1")  # -> hb_obj; plug-in component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
addsubface = HBAddSubface(hb_obj=flatten(id), sub_faces=flatten(aperture.apertures))  # -> report, hb_obj, unmatched; plug-in component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
constantschedule_3 = HBConstantSchedule(values="1")  # -> out, schedule, idf_text; plug-in component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
ventcontrol = HBVentilationControl(max_in_temp="26", min_out_temp="17", max_out_temp="23")  # -> vent_cntrl; plug-in component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
windowopen = HBWindowOpening(rooms=flatten(addsubface.hb_obj), vent_cntrl=ventcontrol)  # -> report, rooms; plug-in component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

# ----
# Shade objects
shade = HBShade(geo=[deep_arch_shading, courtyardshading])  # -> out, shades; plug-in component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
model = HBModel(rooms=flatten(windowopen.rooms), shades=flatten(shade.shades))  # -> out, model; plug-in component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
vizbytype = HBVisualizeByType(hb_objs=model.model)  # -> walls, interior_walls, roofs, ceilings, exterior_floors, interior_floors, air_walls, apertures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; plug-in component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
mesh = Mesh([vizbytype.walls, vizbytype.interior_walls, vizbytype.roofs, vizbytype.exterior_floors, vizbytype.interior_floors, vizbytype.apertures, vizbytype.air_walls, vizbytype.outdoor_shades])

afn = HBAirflowNewtwork(model=model.model)  # -> report, model; plug-in component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

# ----
# Simulation
panel_5 = Panel("Zone Cooltower Sensible Heat Loss Energy [J]")
# KEY NOTES: One needs to ask for what outputs you need from the simulation.
boolean_toggle = BooleanToggle(True)
simoutput = HBSimulationOutput(
    zone_energy_use=boolean_toggle,
    system_energy_use=boolean_toggle,
    gains_and_losses=boolean_toggle,
    comfort_metrics=boolean_toggle,
    surface_temperature=boolean_toggle,
    surface_energy_flow=boolean_toggle)  # -> out, sim_output; plug-in component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
shadowcalc = HBShadowCalculation(calc_method="PixelCounting")  # -> shadow_calc; plug-in component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

customoutput = HBCustomSimulationOutput(base_sim_output=simoutput.sim_output, output_names=panel_5)  # -> report, sim_output; plug-in component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

simpar = HBSimulationParameter(output=customoutput.sim_output, timestep=6, shadow_calc=shadowcalc)  # -> sim_par; plug-in component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

# ----
# Simulation
panel_6 = Panel("https://climate.onebuilding.org/WMO_Region_1_Africa/EGY_Egypt/AN_Aswan_Aswan/EGY_AN_Aswan.Intl.AP.624140_TMYx.zip")
downloadepw = LBDownloadWeather(weather_URL=panel_6)  # -> epw_file, stat_file, ddy_file; plug-in component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
lb_falsestarttoggle = LBFalseStartToggle(True)
merge_2 = Merge(Data1=merge, Data2=panel_4)  # -> flatten(Result)
modeltoosm = HBModelToOSM(
    model=model.model,
    epw_file=downloadepw.epw_file,
    sim_par=simpar,
    add_str=merge_2,
    write=lb_falsestarttoggle,
    run=lb_falsestarttoggle)  # -> out, jsons, osw, osm, idf, sql, zsz, rdd, html; plug-in component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

importepw = LBImportEPW(epw_file=downloadepw.epw_file)  # -> location, dry_bulb_temperature, dew_point_temperature, relative_humidity, wind_speed, wind_direction, direct_normal_rad, diffuse_horizontal_rad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; plug-in component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
hourlyplot_2 = LBHourlyPlot(data=flatten(importepw.dry_bulb_temperature))  # -> out, mesh, legend, borders, labels, title, vis_set; plug-in component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

# ----
# Reading Custom Results
panel_7 = Panel("tower ")
panel_8 = Panel("Zone Cooltower Sensible Heat Loss Energy")
readrdd = HBReadResultDictionary(rdd=modeltoosm.rdd, keywords=panel_7)  # -> outputs; plug-in component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
panel_9 = Panel(readrdd)
customresult = HBReadCustomResult(sql=modeltoosm.sql, output_names=panel_8)  # -> results; plug-in component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
xdata = LBDeconstructData(data=customresult)  # -> header, values; plug-in component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
timeop = LBTimeIntervalOperation(data=customresult)  # -> daily, monthly, mon_per_hr; plug-in component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
point = Point(Point(0.005707024844, 151.8923004, 0))
monthlychart = LBMonthlyChart(data=timeop.monthly, base_pt=point, global_title=panel_8)  # -> out, data_mesh, data_lines, col_lines, legend, borders, labels, y_title, title, vis_set; plug-in component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

faceresult = HBReadFaceResult(sql=modeltoosm.sql)  # -> face_indoor_temp, face_outdoor_temp, face_energy_flow; plug-in component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
# Read Results-Energy Balance
roomenergyresult = HBReadRoomEnergyResult(sql=modeltoosm.sql)  # -> cooling, heating, lighting, electric_equip, gas_equip, process, hot_water, fan_electric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; plug-in component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
loadbalance = HBThermalLoadBalance(
    rooms_model=flatten(model.model),
    cooling=roomenergyresult.cooling,
    heating=roomenergyresult.heating,
    lighting=roomenergyresult.lighting,
    electric_equip=roomenergyresult.electric_equip,
    people_gain=roomenergyresult.people_gain,
    solar_gain=roomenergyresult.solar_gain,
    infiltration_load=roomenergyresult.infiltration_load,
    mech_vent_load=roomenergyresult.mech_vent_load,
    nat_vent_load=roomenergyresult.nat_vent_load,
    face_energy_flow=faceresult.face_energy_flow)  # -> report, balance, balance_stor, norm_bal, norm_bal_stor; plug-in component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
colrange = LBColorRange(index=Slider(19, range=0..100))  # -> colors; plug-in component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
timeop_2 = LBTimeIntervalOperation(data=loadbalance.norm_bal_stor)  # -> daily, monthly, mon_per_hr; plug-in component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
legendpar = LBLegendParameters(colors=colrange)  # -> leg_par; plug-in component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
point_2 = Point(Point(0.005707024844, 74.6662539, 0))
monthlychart_2 = LBMonthlyChart(data=timeop_2.monthly, base_pt=point_2, stack=Toggle(True), legend_par=legendpar)  # -> out, data_mesh, data_lines, col_lines, legend, borders, labels, y_title, title, vis_set; plug-in component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

# ----
# Normalising results
hb_room_attributes = HBRoomAttributes({"Display Name": "display_name", "Simulation Name (Identifier)": "identifier", "Multiplier": "multiplier", "Floor Area Excluded": "exclude_floor_area", "Story": "story", "Volume": "volume", "Gross Floor Area": "floor_area", "Exposed Area": "exposed_area", "Exterior Wall Area": "exterior_wall_area", "Exterior Aperture Area": "exterior_aperture_area", "Average Floor Elevation": "average_floor_height"}, selected="Gross Floor Area")
labelrooms = HBLabelRooms(rooms_model=flatten(model.model), attribute=hb_room_attributes)  # -> label_text, base_pts, labels, wire_frame; plug-in component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
xdata_2 = LBDeconstructData(data=roomenergyresult.cooling)  # -> header, values; plug-in component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
xdata_3 = LBDeconstructData(data=roomenergyresult.heating)  # -> header, values; plug-in component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
mass_addition = MassAddition(Input=xdata_2.values)  # -> Result, PartialResults
mass_addition_2 = MassAddition(Input=xdata_3.values)  # -> Result, PartialResults
division = Division(A=mass_addition.Result, B=labelrooms.label_text)
division_2 = Division(A=mass_addition_2.Result, B=labelrooms.label_text)
cooling_load_kwh_m2 = Panel(division)
heating_load_kwh_m2 = Panel(division_2)

# ----
# Labels
panel_10 = Panel("Cooling Load (kWh/m2):")
legend2d = LBLegend2DParameters(text_height=Slider(47, range=0..100))  # -> leg_par2d; plug-in component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
legend2d_2 = LBLegend2DParameters(origin_y=Slider(113, range=0..150), text_height=Slider(47, range=0..100))  # -> leg_par2d; plug-in component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
concatenate_3 = Concatenate(FragmentA=panel_10, FragmentB=division)
concatenate_4 = Concatenate(FragmentA="Heating Load (kWh/m2):", FragmentB=division_2)
text2d = LBScreenOrientedText(text=concatenate_3, leg_par2d=legend2d)  # plug-in component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
text2d_2 = LBScreenOrientedText(text=concatenate_4, leg_par2d=legend2d_2)  # plug-in component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
