# Grasshopper definition 03_11_2026_Stack Ventilation_AFN.gh (Grasshopper 1.0.8)
# plug-ins: Human, Bifocals, LadybugGrasshopper

number_slider = Slider(10, range=0..10)
# INSERT_Weather Data and Analysis Period
panel = Panel("https://climate.onebuilding.org/WMO_Region_1_Africa/EGY_Egypt/AN_Aswan_Aswan/EGY_AN_Aswan.Intl.AP.624140_TMYx.zip")
analysisperiod = LBAnalysisPeriod(
    start_month=number_slider,
    start_day=Slider(21, range=0..100),
    start_hour=0,
    end_month=number_slider,
    end_day=Slider(23, range=0..100))  # -> period, hoys, dates; plug-in component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

# ----
# INSERT_Main building Zone Construction
# and Program
opposite_window_only_in_no_chimney_case = Brep(<brep referenced from the Rhino model>)
# INSERT_Input Geometry for the main Building Zone
primary_window = Brep(<brep referenced from the Rhino model>)
primary_window_shade = Brep(<brep referenced from the Rhino model>)
room_geometry = Brep(<brep referenced from the Rhino model>)

hb_building_programs = HBBuildingPrograms({"LargeOffice", "MediumOffice", "SmallOffice", "MidriseApartment", "HighriseApartment", "Retail", "StripMall", "PrimarySchool", "SecondarySchool", "SmallHotel", "LargeHotel", "Hospital", "Outpatient", "Laboratory", "Warehouse", "SuperMarket", "FullServiceRestaurant", "QuickServiceRestaurant", "Courthouse", "College", "LargeDataCenterHighITE", "LargeDataCenterLowITE", "SmallDataCenterHighITE", "SmallDataCenterLowITE"}, selected="MidriseApartment")
hb_construction_types = HBConstructionTypes({"SteelFramed", "WoodFramed", "Mass", "Metal Building"}, selected="Mass")
hb_climate_zones = HBClimateZones({"1 - Very Hot": "1", "2 - Hot": "2", "3 - Warm": "3", "4 - Mixed": "4", "5 - Cool": "5", "6 - Cold": "6", "7 - Very Cold": "7", "8 - Subarctic": "8"}, selected="2 - Hot")
constrsetclimate = HBConstructionSetByClimate(climate_zone=hb_climate_zones, constr_type=hb_construction_types)  # -> constr_set; plug-in component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

# ----
# INSERT_Chimney Zone Construction
panel_2 = Panel("insulated")
searchconstrs = HBSearchConstructions(keywords=panel_2)  # -> opaque_constrs, window_constrs, shade_constrs; plug-in component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
list = ItemSelector(
    searchconstrs.opaque_constrs,
    {"Typical Insulated 6in Slab Floor", "Typical Insulated 8in Slab Floor", "Typical Insulated Basement Mass Wall", "Typical Insulated Basement Mass Wall-R10", "Typical Insulated Basement Mass Wall-R13", "Typical Insulated Basement Mass Wall-R15"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}, selected="Typical Insulated Exterior Mass Floor Ceiling")
list_2 = ItemSelector(
    searchconstrs.opaque_constrs,
    {"Typical Insulated 6in Slab Floor", "Typical Insulated 8in Slab Floor", "Typical Insulated Basement Mass Wall", "Typical Insulated Basement Mass Wall-R10", "Typical Insulated Basement Mass Wall-R13", "Typical Insulated Basement Mass Wall-R15"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}, selected="Typical Insulated Basement Mass Wall-R10")
exteriorsubset = HBExteriorConstructionSubset(exterior_wall=list_2, exterior_roof=list)  # -> exterior_set; plug-in component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
constructionset = HBConstructionSet(exterior_subset=exteriorsubset)  # -> constr_set; plug-in component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

# ----
# INSERT_Input Geometry for the Chimney
chimney_geometry = Brep(<brep referenced from the Rhino model>)
chimney_openings = Brep([<brep referenced from the Rhino model> x2])

# ----
# Setting up the zone geometry
toggle = BooleanToggle(False)
roomsolid = HBRoomFromSolid(geo=flatten(room_geometry), constr_set=constrsetclimate, program=hb_building_programs, conditioned=toggle)  # -> out, rooms; plug-in component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
id = HBSetIdentifier(hb_obj=roomsolid.rooms, id="MainRoom")  # -> hb_obj; plug-in component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

# ----
# Setting up the chimney geometry
roomsolid_2 = HBRoomFromSolid(geo=flatten(chimney_geometry), constr_set=constructionset, conditioned=Toggle(False))  # -> out, rooms; plug-in component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
plenum = HBPlenum(rooms=roomsolid_2.rooms)  # -> rooms; plug-in component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
id_2 = HBSetIdentifier(hb_obj=plenum, id="Chimney")  # -> hb_obj; plug-in component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

# ----
# Zone Apertures
toggle_2 = BooleanToggle(True)
ventcontrol = HBVentilationControl(
    min_in_temp=Slider(26, range=0..100),
    min_out_temp=Slider(17, range=0..100),
    max_out_temp=Slider(25, range=0..100),
    delta_temp="1")  # -> vent_cntrl; plug-in component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
# AFN for chimney effect
aperture = HBAperture(geo=[primary_window, opposite_window_only_in_no_chimney_case], operable=toggle_2)  # -> out, apertures; plug-in component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
addsubface = HBAddSubface(hb_obj=flatten(id), sub_faces=flatten(aperture.apertures))  # -> out, hb_obj, unmatched; plug-in component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
windowopen = HBWindowOpening(rooms=flatten(addsubface.hb_obj), vent_cntrl=ventcontrol)  # -> report, rooms; plug-in component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
shade = HBShade(geo=primary_window_shade)  # -> out, shades; plug-in component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

genes = GenePool(
    Decimals=0,
    Maximum=1,
    Minimum=0,
    Value=[0.5, 0.5, 0.5, 1, 1, 1, 1, 1, 1, 1, 0.5, 0.5, 0.5, 0.5, 0.5, 0.5, 0.5, 0.5, 0.5, 0.5, 0.5, 0.5, 0.5, 0.5])
# Chimney Apertures
toggle_3 = BooleanToggle(True)
aperture_2 = HBAperture(geo=chimney_openings, operable=toggle_3)  # -> out, apertures; plug-in component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
constantschedule = HBConstantSchedule(values=genes, name="SummerSchedule")  # -> out, schedule, idf_text; plug-in component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
addsubface_2 = HBAddSubface(hb_obj=flatten(id_2), sub_faces=flatten(aperture_2.apertures))  # -> out, hb_obj, unmatched; plug-in component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
ventcontrol_2 = HBVentilationControl(schedule=constantschedule.schedule)  # -> vent_cntrl; plug-in component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
windowopen_2 = HBWindowOpening(rooms=flatten(addsubface_2.hb_obj), vent_cntrl=ventcontrol_2)  # -> report, rooms; plug-in component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

# ----
# Setting Load Values
applyloadvals = HBApplyLoadValues(
    room_or_program=flatten(windowopen.rooms),
    gas_per_floor="0",
    hot_wtr_per_floor="0",
    vent_per_floor="0",
    vent_per_person="0",
    vent_ach="0")  # -> out, mod_obj; plug-in component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
applysetpointvals = HBApplySetpointValues(
    room_or_program=flatten(applyloadvals.mod_obj),
    cooling_setpt=Slider(27, range=0..100),
    heating_setpt=Slider(16, range=0..100))  # -> out, mod_obj; plug-in component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

# ----
# TEST 1_Use the 'Room' Output here for
# 'No Chimney Case'.
panel_3 = Panel("NoEconomizer")
idealair = HBIdealAir(rooms=flatten(applysetpointvals.mod_obj), economizer=panel_3)  # -> out, rooms; plug-in component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

toggle_4 = BooleanToggle(True)
# Adjacancy with the Chimney
toggle_5 = BooleanToggle(True)
intsolid = HBIntersectSolids(rooms=flatten([idealair.rooms, windowopen_2.rooms]), run=toggle_5)  # -> int_rooms; plug-in component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

# ----
# TEST 2_Use the 'adj_Room' Output
# here for 'With Chimney Case'.
solveadj = HBSolveAdjacency(rooms=flatten(intsolid), air_boundary=toggle_4, run=toggle_4)  # -> out, adj_rooms; plug-in component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

model = HBModel(rooms=flatten(solveadj.adj_rooms), shades=flatten(shade.shades))  # -> out, model; plug-in component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
afn = HBAirflowNewtwork(model=model.model)  # -> report, model; plug-in component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
# Simulation Setup
vizbytype = HBVisualizeByType(hb_objs=afn.model)  # -> walls, interior_walls, roofs, ceilings, exterior_floors, interior_floors, air_walls, apertures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; plug-in component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

# ---- group: AFN required outputs
panel_4 = Panel("AFN Linkage Node 1 to Node 2 Volume Flow Rate")
panel_5 = Panel("AFN Zone Ventilation Air Change Rate")
panel_6 = Panel("Zone Outdoor Air Drybulb Temperature")
panel_7 = Panel("AFN Linkage Node 2 to Node 1 Volume Flow Rate")
panel_8 = Panel("AFN Linkage Node 1 to Node 2 Pressure Difference")
panel_9 = Panel("AFN Surface Venting Window or Door Opening Factor")

# ----
toggle_6 = BooleanToggle(True)
simoutput = HBSimulationOutput(
    zone_energy_use=toggle_6,
    gains_and_losses=toggle_6,
    comfort_metrics=toggle_6,
    surface_temperature=toggle_6,
    surface_energy_flow=toggle_6)  # -> out, sim_output; plug-in component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
customoutput = HBCustomSimulationOutput(base_sim_output=simoutput.sim_output, output_names=[panel_4, panel_7, panel_8, panel_9, panel_6, panel_5])  # -> out, sim_output; plug-in component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
downloadepw = LBDownloadWeather(weather_URL=panel)  # -> epw_file, stat_file, ddy_file; plug-in component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
simpar = HBSimulationParameter(output=customoutput.sim_output, run_period=analysisperiod.period, timestep=6)  # -> sim_par; plug-in component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
importstat = LBImportSTAT(stat_file=downloadepw.stat_file)  # -> location, ashrae_zone, koppen_zone, clear_dir_norm_rad, clear_diff_horiz_rad, ann_heat_dday_996, ann_heat_dday_990, ann_cool_dday_004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; plug-in component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
falsestart = LBFalseStartToggle(True)
modeltoosm = HBModelToOSM(model=afn.model, epw_file=downloadepw.epw_file, sim_par=simpar, write=falsestart, run=falsestart)  # -> out, jsons, osw, osm, idf, sql, zsz, rdd, html; plug-in component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

importepw = LBImportEPW(epw_file=downloadepw.epw_file)  # -> location, dry_bulb_temperature, dew_point_temperature, relative_humidity, wind_speed, wind_direction, direct_normal_rad, diffuse_horizontal_rad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; plug-in component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
colrange = LBColorRange(index=Slider(4, range=0..10))  # -> colors; plug-in component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
windrose = LBWindRose(data=importepw.wind_speed, wind_direction=importepw.wind_direction)  # -> out, mesh, compass, orient_line, freq_line, windrose_line, legend, title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; plug-in component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
legendpar = LBLegendParameters(min=Slider(0, range=0..100), max=Slider(40, range=0..100), colors=colrange)  # -> leg_par; plug-in component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
hourlyplot = LBHourlyPlot(data=flatten(importepw.dry_bulb_temperature), statement="a<30")  # -> out, mesh, legend, borders, labels, title, vis_set; plug-in component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

# ----
# Finding Analysis Period and
# prev. wind direction
number_slider_2 = Slider(0.5, range=0..1)
gridrooms = HBSensorGridFromRooms(rooms=model.model, grid_size=number_slider_2, dist_floor=number_slider_2, wall_offset=number_slider_2)  # -> grid, points, mesh; plug-in component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
falsestart_2 = LBFalseStartToggle(False)
assigngridsviews = HBAssignGridsAndViews(model=afn.model, grids=flatten(gridrooms.grid))  # -> model; plug-in component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
adaptivemap = HBAdaptiveComfortMap(model=assigngridsviews, epw=downloadepw.epw_file, ddy=downloadepw.ddy_file, run=falsestart_2)  # -> out, env_conds, op_temp, condition, deg_neut, TCP, HSP, CSP; plug-in component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
heatmap = LBSpatialHeatmap(values=adaptivemap.TCP, mesh=gridrooms.mesh)  # -> mesh, legend, title, colors, legend_par, vis_set; plug-in component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

# ----
# AFN Linkage Node 1 to Node 2 Volume Flow Rate
# AFN Linkage Node 2 to Node 1 Volume Flow Rate
# AFN Linkage Node 1 to Node 2 Pressure Difference
# AFN Surface Venting Window or Door Opening Factor
# Zone Outdoor Air Drybulb Temperature
panel_10 = Panel("AFN Zone Ventilation Air Change Rate")

# ----
# AFN Custom Results
number_slider_3 = Slider(4, range=0..10)

roomcomfortresult = HBReadRoomComfortResult(sql=modeltoosm.sql)  # -> oper_temp, air_temp, rad_temp, rel_humidity, unmet_heat, unmet_cool; plug-in component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
xdata = LBDeconstructData(data=roomcomfortresult.oper_temp)  # -> header, values; plug-in component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
legendpar_2 = LBLegendParameters(min=Slider(0, range=0..100), max=Slider(40, range=0..100), vert_or_horiz=Toggle(True))  # -> leg_par; plug-in component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
item = ListItem(List=roomcomfortresult.oper_temp, Index=Slider(0, range=0..1), Wrap=True)  # -> Item, Item1
monthlychart = LBMonthlyChart(data=roomcomfortresult.oper_temp, y_axis_title=number_slider_3, legend_par=legendpar_2)  # -> out, data_mesh, data_lines, col_lines, legend, borders, labels, y_title, title, vis_set; plug-in component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

# ----
# Comfort charts- Results
number_slider_4 = Slider(1, range=0..1)
# Operative Temperature_Results
number_slider_5 = Slider(40, range=0..100)
dom = ConstructDomain(DomainStart=number_slider_4, DomainEnd=number_slider_5)
pt = ConstructPoint(XCoordinate=0, YCoordinate=0, ZCoordinate=0)
adaptivechart = LBAdaptiveChart(out_temp=importepw.dry_bulb_temperature, air_temp=item.Item1, base_pt=pt, prevail_range=dom)  # -> out, total_comfort, comfort_data, condition_data, polygon, title, prevail_lines, operative_lines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; plug-in component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
hourlyplot_2 = LBHourlyPlot(data=flatten(adaptivechart.condition_data))  # -> out, mesh, legend, borders, labels, title, vis_set; plug-in component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
xdata_2 = LBDeconstructData(data=adaptivechart.comfort_data)  # -> header, values; plug-in component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
xheader = LBDeconstructHeader(header=xdata_2.header)  # -> data_type, unit, a_period, metadata; plug-in component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
concat = Concatenate(FragmentA=xheader.data_type, FragmentB=xheader.metadata)
join = TextJoin(Text=flatten([adaptivechart.total_comfort, concat]), Join="-")
legend2d = LBLegend2DParameters(text_height=Slider(40, range=0..100))  # -> leg_par2d; plug-in component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
text2d = LBScreenOrientedText(text=join, leg_par2d=legend2d)  # plug-in component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

customresult = HBReadCustomResult(sql=modeltoosm.sql, output_names=panel_10)  # -> graft(results); plug-in component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
bang = ExplodeTree(Data=customresult)  # -> Branch0, Branch1, Branch2, Branch3, Branch4, Branch5
xdata_3 = LBDeconstructData(data=bang.Branch0)  # -> header, values; plug-in component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
panel_11 = Panel(xdata_3.values)
panel_12 = Panel(xdata_3.header)
monthlychart_2 = LBMonthlyChart(stack=Toggle(True))  # -> out, data_mesh, data_lines, col_lines, legend, borders, labels, y_title, title, vis_set; plug-in component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
hourlyplot_3 = LBHourlyPlot(data=bang.Branch0)  # -> report, mesh, legend, borders, labels, title, vis_set; plug-in component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
