# Grasshopper definition Thermal Mass Experiment.gh (Grasshopper 1.0.7)
# plug-ins: Bifocals, LadybugGrasshopper

# ---- group: Room
# 1A. Create a Room - Option 1
room_area = Slider(40, range=36..48)
lenght_of_room = Slider(8, range=4..12)
wall_height = Slider(3, range=0..10)
roof_height = Slider(0, range=-1..3)
division = Division(A=room_area, B=lenght_of_room)
expression = Expression(x=division, y="0", z="2", Expression="(x+y)/z")
expression_2 = Expression(x=wall_height, y=roof_height, Expression="x+y")
construct_point_5 = ConstructPoint(XCoordinate=0, YCoordinate="0", ZCoordinate=wall_height)
construct_point_1 = ConstructPoint(XCoordinate=0, YCoordinate=expression, ZCoordinate=expression_2)
construct_point_2 = ConstructPoint(XCoordinate=0, YCoordinate=division, ZCoordinate=wall_height)
construct_point_3 = ConstructPoint(XCoordinate=0, YCoordinate=division, ZCoordinate=0)
construct_point_4 = ConstructPoint(XCoordinate=0, YCoordinate="0", ZCoordinate=0)
unit_x = UnitX(Factor=lenght_of_room)
line_34 = Line(StartPoint=construct_point_3, EndPoint=construct_point_4)
line_45 = Line(StartPoint=construct_point_5, EndPoint=construct_point_4)
line_51 = Line(StartPoint=construct_point_5, EndPoint=construct_point_1)
line_12 = Line(StartPoint=construct_point_1, EndPoint=construct_point_2)
line_23 = Line(StartPoint=construct_point_2, EndPoint=construct_point_3)
boundary_surfaces = BoundarySurfaces(Edges=[line_23, line_12, line_34, line_45, line_51])
extrude = Extrude(Base=boundary_surfaces, Direction=unit_x)

# ----
# 1B. Create a Room - Option 2
number_slider = Slider(2, range=0..10)
width = Slider(6, range=0..10)
wall_height_2 = Slider(3, range=0..10)
roof_height_2 = Slider(2, range=0..10)
room_length = Slider(8, range=0..10)
division_2 = Division(A=width, B=number_slider)
neg = Negative(Value=division_2)
pt = ConstructPoint(XCoordinate=0, YCoordinate=0, ZCoordinate=0)
vec = VectorXYZ(XComponent=[neg, division_2], YComponent=0, ZComponent=0)  # -> Vector, Length
move = Move(Geometry=pt, Motion=vec.Vector)  # -> Geometry, Transform
Z = UnitZ(Factor=wall_height_2)
pline = PolyLine(Vertices=move.Geometry, Closed=False)
move_2 = Move(Geometry=move.Geometry, Motion=Z)  # -> Geometry, Transform
move_3 = Move(Geometry=pt, Motion=Z)  # -> Geometry, Transform
ln = Line(StartPoint=move.Geometry, EndPoint=move_2.Geometry)
Z_2 = UnitZ(Factor=roof_height_2)
move_4 = Move(Geometry=move_3.Geometry, Motion=Z_2)  # -> Geometry, Transform
ln_2 = Line(StartPoint=move_4.Geometry, EndPoint=move_2.Geometry)
join = JoinCurves(Curves=[ln_2, ln, pline], Preserve=False)
Y = UnitY(Factor=room_length)
boundary = BoundarySurfaces(Edges=join)
extr = Extrude(Base=boundary, Direction=Y)

# ----
# Roof Materials
panel = Panel("0.013")
opaquemat = HBOpaqueMaterial(thickness=panel, conductivity="0.16", density="800", spec_heat="1090")  # -> mat; plug-in component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
opaquemat_2 = HBOpaqueMaterial(thickness="0.02", conductivity="0.84", density="1900", spec_heat="840")  # -> mat; plug-in component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
merge = Merge(Data1=opaquemat_2, Data2=opaquemat)
opaqueconstr = HBOpaqueConstruction(name="Roof", materials=merge)  # -> constr; plug-in component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

# ----
# Wall Materials
panel_2 = Panel("Outside Render Surface")
# Light Weight Structure
opaquemat_3 = HBOpaqueMaterial(name=panel_2, thickness="0.02", conductivity="0.72", density="1850", spec_heat="840")  # -> mat; plug-in component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
opaquemat_4 = HBOpaqueMaterial(thickness="0.013", conductivity="0.16", density="800", spec_heat="1090")  # -> mat; plug-in component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
merge_2 = Merge(Data1=opaquemat_3, Data2=opaquemat_4)
opaqueconstr_2 = HBOpaqueConstruction(name="Wall", materials=merge_2)  # -> constr; plug-in component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

number_slider_2 = Slider(0.3, range=0.15..0.5)
number_slider_3 = Slider(0.3, range=0.15..0.5)

# ----
# Climate Data
panel_3 = Panel("https://climate.onebuilding.org/WMO_Region_1_Africa/MAR_Morocco/MS_Marrakech-Safi/MAR_MS_Marrakesh-Menara.AP.602300_TMYx.zip")
epwmap = LBEPWmap(epw_map=Toggle(False))  # -> report; plug-in component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
downloadepw = LBDownloadWeather(weather_URL=panel_3)  # -> epw_file, stat_file, ddy_file; plug-in component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
importepw = LBImportEPW(epw_file=downloadepw.epw_file)  # -> location, dry_bulb_temperature, dew_point_temperature, relative_humidity, wind_speed, wind_direction, direct_normal_rad, diffuse_horizontal_rad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; plug-in component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

# ----
# Wall Materials
panel_4 = Panel("2")
# Heavy Mass Structure
opaquemat_5 = HBOpaqueMaterial(thickness=number_slider_3, conductivity=panel_4, density="2400", spec_heat="1000")  # -> mat; plug-in component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
merge_3 = Merge(Data1=opaquemat_5)
opaqueconstr_3 = HBOpaqueConstruction(name="Wall", materials=merge_3)  # -> constr; plug-in component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

# ----
# Roof Materials
panel_5 = Panel("2")
opaquemat_6 = HBOpaqueMaterial(thickness=number_slider_2, conductivity=panel_5, density="2400", spec_heat="1000")  # -> mat; plug-in component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
merge_4 = Merge(Data1=opaquemat_6)
opaqueconstr_4 = HBOpaqueConstruction(name="Roof", materials=merge_4)  # -> constr; plug-in component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

# ----
# 2. Rotating the Room
number_slider_4 = Slider(0, range=0..360)
radians = Radians(Degrees=number_slider_4)
area = Area(Geometry=extrude)  # -> Area, Centroid
negative = Negative(Value=radians)
xy_plane = XYPlane(Origin=area.Centroid)
rotate = Rotate(Geometry=extrude, Angle=negative, Plane=xy_plane)  # -> Geometry, Transform

# ----
# 2. Rotating the Room
number_slider_5 = Slider(0, range=0..360)
area_2 = Area(Geometry=extr)  # -> Area, Centroid
radians_2 = Radians(Degrees=number_slider_5)
xy_plane_2 = XYPlane(Origin=area_2.Centroid)
rotate_2 = Rotate(Geometry=extr, Angle=radians_2, Plane=xy_plane_2)  # -> Geometry, Transform

galapagos = Galapagos(fitness=number, gene=[number_slider_2, number_slider_3])
data = Data(rotate_2.Geometry)
room = Brep(rotate.Geometry)

# ----
# 3. Construction Set
exteriorsubset = HBExteriorConstructionSubset(exterior_wall=opaqueconstr_3, exterior_roof=opaqueconstr_4)  # -> exterior_set; plug-in component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
constructionset = HBConstructionSet(exterior_subset=exteriorsubset)  # -> constr_set; plug-in component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
roomsolid = HBRoomFromSolid(
    geo=flatten(room),
    name="Single Zone",
    constr_set=constructionset,
    conditioned=Toggle(True),
    roof_angle=Slider(75, range=0..100))  # -> out, rooms; plug-in component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

versions = HBCheckVersions()  # -> lbt_gh, python, radiance, openstudio, energyplus; plug-in component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
panel_6 = Panel([versions.lbt_gh, versions.python, versions.radiance, versions.openstudio, versions.energyplus])

# ----
# Make a Window
number_slider_6 = Slider(0.2, range=0.2..1.2)
facparam = HBFacadeParameters(north=0, east=0, south=number_slider_6, west=0)  # -> fac_par; plug-in component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
aperturesbyratio = HBAperturesByRatio(
    hb_objs=flatten(roomsolid.rooms),
    ratio=facparam,
    subdivide=Toggle(True),
    win_height="1",
    sill_height="1",
    operable=Toggle(True))  # -> out, hb_objs; plug-in component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

annualloads = HBAnnualLoads(rooms=flatten(aperturesbyratio.hb_objs), epw_file=downloadepw.epw_file, run=Toggle(True))  # -> out, total_load, cooling, heating, lighting, equip, process, hot_water, balance; plug-in component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
mass_addition = MassAddition(Input=annualloads.total_load)  # -> Result, PartialResults
number = Number(mass_addition.Result)
panel_7 = Panel(number)

# ----
# Create HB Model
model = HBModel(rooms=flatten(aperturesbyratio.hb_objs))  # -> report, model; plug-in component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

# ----
# HB Simulation
toggle = BooleanToggle(True)
simoutput = HBSimulationOutput(
    zone_energy_use=toggle,
    gains_and_losses=toggle,
    comfort_metrics=toggle,
    surface_temperature=toggle,
    surface_energy_flow=toggle)  # -> report, sim_output; plug-in component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
analysisperiod = LBAnalysisPeriod(
    start_month=Slider(5, range=0..10),
    start_day=Slider(25, range=0..100),
    start_hour=Slider(0, range=0..100),
    end_month=Slider(5, range=0..10),
    end_day=Slider(27, range=0..100),
    end_hour=Slider(23, range=0..100),
    timestep=Slider(1, range=0..1))  # -> period, hoys, dates; plug-in component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
simpar = HBSimulationParameter(output=simoutput.sim_output, run_period=analysisperiod.period, timestep=6, terrain="Suburbs")  # -> sim_par; plug-in component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
falsestart = LBFalseStartToggle(False)
modeltoosm = HBModelToOSM(model=model.model, epw_file=downloadepw.epw_file, sim_par=simpar, write=Toggle(False), run=falsestart)  # -> report, jsons, osw, osm, idf, sql, zsz, rdd, html; plug-in component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

opaquemat_7 = HBOpaqueMaterial(thickness="0.3", conductivity="0.52", density="1200", spec_heat="1000")  # -> mat; plug-in component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
opaquemat_8 = HBOpaqueMaterial(thickness="0.02", conductivity="0.04", density="265", spec_heat="836")  # -> mat; plug-in component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
# Wall Materials
panel_8 = Panel("Wall")
merge_5 = Merge(Data1=opaquemat_7, Data2=opaquemat_8)
opaqueconstr_5 = HBOpaqueConstruction(name=panel_8, materials=merge_5)  # -> constr; plug-in component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

opaquemat_9 = HBOpaqueMaterial(thickness="0.15", conductivity="0.09", density="350", spec_heat="1000")  # -> mat; plug-in component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
opaquemat_10 = HBOpaqueMaterial(thickness="0.03", conductivity="0.23", density="1100", spec_heat="1000")  # -> mat; plug-in component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
# Roof Materials
panel_9 = Panel("Roof")
merge_6 = Merge(Data1=opaquemat_10, Data2=opaquemat_9)
opaqueconstr_6 = HBOpaqueConstruction(name=panel_9, materials=merge_6)  # -> constr; plug-in component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

data_2 = Data(model.model)

# ----
# 6. Visualize HB Model
decnstrobj = HBDeconstructObject(hb_obj=aperturesbyratio.hb_objs)  # -> faces, apertures, doors, shades; plug-in component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
vizbytype = HBVisualizeByType(hb_objs=model.model)  # -> walls, interior_walls, roofs, ceilings, exterior_floors, interior_floors, air_walls, apertures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; plug-in component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
lablefaces = HBLabelFaces(hb_objs=flatten(model.model))  # -> label_text, base_pts, labels, wire_frame; plug-in component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
panel_10 = Panel(decnstrobj.faces)
# Doubleclick Me!
mesh = Mesh([vizbytype.walls, vizbytype.roofs, vizbytype.apertures, vizbytype.interior_floors])

faceresult = HBReadFaceResult(sql=modeltoosm.sql)  # -> face_indoor_temp, face_outdoor_temp, face_energy_flow; plug-in component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
colorfaces = HBColorFaces(data=flatten(faceresult.face_indoor_temp), hb_objs=flatten(data_2))  # -> report, mesh, wire_frame, legend, title, faces, colors, values, vis_set; plug-in component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
# Indoor Air Temp
colorfaces_2 = HBColorFaces(data=flatten(faceresult.face_outdoor_temp), hb_objs=flatten(data_2))  # -> report, mesh, wire_frame, legend, title, faces, colors, values, vis_set; plug-in component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

# ----
# Result
# Select Wall 6
number_slider_7 = Slider(6, range=1..9)
item = ListItem(List=faceresult.face_indoor_temp, Index=number_slider_7, Wrap=True)

# ----
# Select Wall 6
number_slider_8 = Slider(6, range=1..9)
item_2 = ListItem(List=faceresult.face_outdoor_temp, Index=number_slider_8, Wrap=True)

panel_11 = Panel(colorfaces.values)
panel_12 = Panel(colorfaces_2.values)
number_2 = Number()
number_3 = Number()
number_4 = Number()
data_recorder = DataRecorder(number_2, DataLimit=-10, RecordData=True)

# ----
# Outdoor Surface Temp
xdata = LBDeconstructData(data=item_2)  # -> header, values; plug-in component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

# ----
# Indoor Surface Temp
xdata_2 = LBDeconstructData(data=item)  # -> header, values; plug-in component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

data_recorder_2 = DataRecorder(number_3, DataLimit=-10, RecordData=True)
data_recorder_3 = DataRecorder(number_4, DataLimit=-10, RecordData=True)
roomcomfortresult = HBReadRoomComfortResult(sql=modeltoosm.sql)  # -> oper_temp, air_temp, rad_temp, rel_humidity, unmet_heat, unmet_cool; plug-in component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
data_recorder_4 = DataRecorder(xdata_2.values, DataLimit=-10, RecordData=True)

# ----
# Heavy Mass Structure Result
# Indoor Surface
# Outdoor Surface
rec = DataRecorder(xdata.values, DataLimit=-10, RecordData=True)
panel_13 = Panel(data_recorder_4)
panel_14 = Panel(rec)

list_length = ListLength(List=data_recorder_2)
cull_index = CullIndex(List=data_recorder_3, Wrap=True)
cull_index_2 = CullIndex(List=data_recorder, Wrap=True)

# ----
# Light Structure Result
# Indoor Surface
# Outdoor Surface
rec_2 = DataRecorder(DataLimit=-10, RecordData=True)
rec_3 = DataRecorder(DataLimit=-10, RecordData=True)
panel_15 = Panel(rec_3)
panel_16 = Panel(rec_2)

xdata_3 = LBDeconstructData(data=roomcomfortresult.oper_temp)  # -> header, values; plug-in component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
sort_list = SortList(ValuesValuesA=cull_index, ValuesA=cull_index_2)  # -> Keys, ValuesValuesA, ValuesA
data_recorder_5 = DataRecorder(xdata_3.values, DataLimit=-10, RecordData=True)
list_item = ListItem(List=sort_list.Keys, Index=0, Wrap=True)
panel_17 = Panel(data_recorder_5)
panel_18 = Panel(sort_list.ValuesValuesA)
panel_19 = Panel(sort_list.ValuesA)
graph = QuickGraph([panel_13, panel_17, panel_14], SortOrder=0)
panel_20 = Panel(list_item)
graph_2 = QuickGraph([rec_3, rec_2], SortOrder=0)
